# Grasshopper definition _1_SocialDistance_Sidewalk_Setup.gh (Grasshopper 1.0.7)
# plug-ins: MeerkatGIS, Pufferfish, Urbano, Human, BearGIS, EleFront, MetaHopper, TT Toolbox

# ----
# Import Notes: Ex: Be sure that you use the CSV not the EXCEL
# Data Collection Source: EX:::>>>-- http://www.pasda.psu.edu/
# EX:::>>>-- http://pittsburghpa.gov/dcp/gis/gis-data-new
path = FilePath()
# Data Import Section
# use yellow to note when importing data in script
path_2 = FilePath()

# ---- group: TT ToolBOX
readxl = ReadExcelSheet(Worksheet="1", Listen=False)  # -> UserMessages, Columns, Rows

# ---- group: ##NAME##:Important Controler
toggle = BooleanToggle(False)

number_slider = Slider(0, range=0..10)

# Remotes and Contollers
# Mark Important Control Components
# with RED and LABLE THIER USE
number_slider_2 = Slider(0, range=0..10)

# ---- group: Display
selobj = GetSelectedObjects()  # -> ComponentObjects, ParamObjects, OtherObjects
lblgrp = LabelGroups(Groups=selobj.OtherObjects, Run=Toggle(True))
setscribble = SetScribbleProperties(Scribble=lblgrp, ScribbleText="Display", ScribbleSize=Slider(15, range=0..100))
setgroup = SetGroupProperties(Group=selobj.OtherObjects, Style=1, NickName="Display", Color=ColourSwatch(SwatchColor=RGBA(0, 251, 255, 133)))

# ---- group: Ref
selobj_2 = GetSelectedObjects()  # -> ComponentObjects, ParamObjects, OtherObjects
lblgrp_2 = LabelGroups(Groups=selobj_2.OtherObjects, Run=Toggle(True))
setscribble_2 = SetScribbleProperties(Scribble=lblgrp_2, ScribbleText="Ref", ScribbleSize=Slider(15, range=0..100))
setgroup_2 = SetGroupProperties(Group=selobj_2.OtherObjects, Style=1, NickName="Ref", Color=ColourSwatch(SwatchColor=RGBA(235, 141, 141, 133)))

# ---- group: Import
selobj_3 = GetSelectedObjects()  # -> ComponentObjects, ParamObjects, OtherObjects
lblgrp_3 = LabelGroups(Groups=selobj_3.OtherObjects, Run=Toggle(True))
setscribble_3 = SetScribbleProperties(Scribble=lblgrp_3, ScribbleText="Import", ScribbleSize=Slider(15, range=0..100))
setgroup_3 = SetGroupProperties(Group=selobj_3.OtherObjects, Style=1, NickName="Import", Color=ColourSwatch(SwatchColor=RGBA(217, 255, 25, 86)))

# ----
selobj_4 = GetSelectedObjects()  # -> ComponentObjects, ParamObjects, OtherObjects
lblgrp_4 = LabelGroups(Groups=selobj_4.OtherObjects, Run=Toggle(True))
setscribble_4 = SetScribbleProperties(Scribble=lblgrp_4, ScribbleSize=Slider(15, range=0..100))
setgroup_4 = SetGroupProperties(Group=selobj_4.OtherObjects, Style=1, Color=ColourSwatch(SwatchColor=RGBA(114, 171, 108, 68)))

# ----
# Select Groups and Pres left "select button" to apply style
panel = Panel("")
selobj_5 = GetSelectedObjects()  # -> ComponentObjects, ParamObjects, OtherObjects
lblgrp_5 = LabelGroups(Groups=selobj_5.OtherObjects, Run=Toggle(True))
setscribble_5 = SetScribbleProperties(Scribble=lblgrp_5, ScribbleText=panel, ScribbleSize=Slider(15, range=0..100))
setgroup_5 = SetGroupProperties(Group=selobj_5.OtherObjects, Style=1, NickName=panel, Color=ColourSwatch(SwatchColor=RGBA(255, 255, 255, 125)))

# ---- group: ##BUBBLE NAME## Notes Pupose or Opperation
# Want this as your Template File?: File->
#     Preferences->
#         Files ->
#             Template File ->
# Notes and Comments
# Panel Heading: Panels are good for giveing blocks of text a little more structure and flexability
# 
# they can be resized and moved around makeing them good for instructions
# SCRIBBLE TITLE - Gives Heading to Section
# SCRIBBLE Text Gives Longer Explanation
# Display / Visual blocks
# For things getting previewed, Give them custom display Colors and
# Clearly Mark them in the script with Blue
data = Data()

# ---- group: ##Stuff being Previewed##
preview = CustomPreview(Shader=ColourSwatch(SwatchColor=RGB(59, 209, 209)))

# ---- group: Color Picker
colour = ColourPicker(PickedColour=RGB(255, 105, 180))

# ----
docinfo = DocumentInfo(AutoUpdate=False, Recursive=False)  # -> DocumentName, DocumentFilePath, Components, Params, _3rdPartyAssemblies
name = Panel(docinfo.DocumentName)
file_path = Panel(docinfo.DocumentFilePath)
plugins = Panel(docinfo._3rdPartyAssemblies)

# ----
# <Sidewalk Analysis Import Script>
# 
# Project # : KPF Code Challange
# Script Author: Nicolas Azel
# Date Created: 4/26/21
# Script Discription
# Imports GIS Data for Use in Sidewalk Analysis
# Plug-in Dependancy
# List Nessisary Plug-ins To Run the Script
# Plug-in Library: CORE.Grasshopper.Public, Version=1.9.6353.28734, Culture=neutral, PublicKeyToken=null
# MetaHopper, Version=1.0.5.0, Culture=neutral, PublicKeyToken=null
# BearGIS, Version=1.0.1.0, Culture=neutral, PublicKeyToken=null
# EleFront, Version=0.4.1.0, Culture=neutral, PublicKeyToken=null
# Human, Version=1.7.0.0, Culture=neutral, PublicKeyToken=null
# MeerkatGIS, Version=1.0.0.0, Culture=neutral, PublicKeyToken=null
# Pufferfish, Version=2.9.0.0, Culture=neutral, PublicKeyToken=null
# Urbano, Version=1.1.0.0, Culture=neutral, PublicKeyToken=null
# Rhino File's
# Data Set's Used
# Data Set File Paths Or Source Directory: See 'Source Data' folder for demo data and the '..\mapping prject' folder for original citywide datasets
rhino_files_associated_with_script = Panel("SocialDistance_Example_Workspace_v001")

# ---- group: export study boundary to shp to clip source data
# Note:
# 
# This script has been run for the example project and is included for workflow reference.
# 
# None of these snipits need to be run to use the demo analysis in part 2
# Export Study Area Boundary
# A
clipping_boundary = Panel("StudyArea::Boundary")
reference_by_layer = ReferenceByLayer(LayerName=clipping_boundary)  # disabled
explode = Explode(Curve=reference_by_layer, Recursive=True)  # -> Segments, Vertices; disabled
join_curves = JoinCurves(Curves=explode.Segments, Preserve=False)  # disabled

# ---- group: import and bake all landuse data
# Parcel Data
# D
file_name_location = Panel("Source Data\MapPLUTO_21v1_clipped.shp")  # disabled
relative_path = RelativePath(Path=file_name_location)  # disabled
relative_path_2 = Panel(relative_path)  # disabled

# ---- group: import and bake sidewalk planametric data
# Sidewalk Planimetrics
# B
file_name_location_2 = Panel("Source Data\NYC_Sidewalk_Planametrics_Clipped.shp")  # disabled
relative_path_3 = RelativePath(Path=file_name_location_2)  # disabled
relative_path_4 = Panel(relative_path_3)  # disabled

# ---- group: import and bake sidewalk centerlines
# Sidewalk Centers with Width
# C
file_name_location_3 = Panel("Source Data\NYC_Sidewalk_Center_widths_meliharvey_Clipped.shp")  # disabled
relative_path_5 = RelativePath(Path=file_name_location_3)  # disabled
relative_path_6 = Panel(relative_path_5)  # disabled

# ---- group: Import Sidewalk plametric Data / import geom
# Sidewalk AREA
# E
layer_name = Panel("Source Data::Sidewalks::Planametric")
reference_by_layer_2 = ReferenceByLayer(LayerName=layer_name)

# ---- group: Preview sidewalk centers with Width Value / import geom
# Sidewalk Centers with Width - Preview Size
# F
layer_name_2 = Panel("Source Data::Sidewalks::Centerline")
reference_by_layer_3 = ReferenceByLayer(LayerName=layer_name_2)

# ---- group: import geom
# Urbano Setup for Route Intencity
# G
layer_name_3 = Panel("StudyArea::Urbano Area")  # disabled
reference_by_layer_4 = ReferenceByLayer(LayerName=layer_name_3)  # disabled

# ----
# Use Note: This is a greate plugin to integrate with the sidewalk analysis.
# 
# This is a functional model for this demo site, but has not been integrated into the part 2 analysis to keep the demo simpler and easier to review
bounding_rectangle = BoundingRectangle(Geometry=reference_by_layer_4, Plane=PlaneXY(0, 0, 0), Axis=0, Slide=0, Union=True)  # -> Bounding, DimensionX, DimensionY; disabled
control_points = ControlPoints(Curve=bounding_rectangle.Bounding)  # -> Points, Weights, Knots; disabled

# ---- group: Import Sidewalk plametric Data
get_user_attributes = GetUserAttributes(Geometry=reference_by_layer_2)  # -> Keys, Values, BakeName
panel_2 = Panel(get_user_attributes.Keys)

# ---- group: Preview sidewalk centers with Width Value / get attributes for width
get_user_attributes_2 = GetUserAttributes(Geometry=reference_by_layer_3)  # -> Keys, Values, BakeName
key_index = Panel("1")
list_item = ListItem(List=get_user_attributes_2.Keys, Index=key_index, Wrap=True)
list_item_2 = ListItem(List=get_user_attributes_2.Values, Index=key_index, Wrap=True)

# ---- group: export study boundary to shp to clip source data
geometry = Geometry(join_curves)  # disabled
area = Area(Geometry=geometry)  # -> Area, Centroid; disabled
name_2 = Panel("Study Area")  # disabled
area_2 = Panel(area.Area)  # disabled
merge = Merge(Data1=name_2, Data2=area_2)  # disabled
geometry_2 = Geometry(geometry)  # disabled

# ----
file_name = Panel("Source Data\NYC_Sidewalk_Planametrics.prj")  # disabled
relative_path_7 = RelativePath(Path=file_name)  # disabled
point_to_lat_long = PointToLatLong(ProjectedPoint=control_points.Points, ProjectionFile=relative_path_7)  # -> Latitude, Longitude; disabled

# ---- group: Preview sidewalk centers with Width Value / color by width and size by width
bounds = Bounds(Numbers=flatten(list_item_2))
deconstruct_domain = DeconstructDomain(Domain=bounds)  # -> Start, End
gradient = Gradient(
    LowerLimit=deconstruct_domain.Start,
    UpperLimit=deconstruct_domain.End,
    Parameter=list_item_2,
    stops=[0: RGB(0, 128, 0), 0.5: RGB(255, 255, 0), 1: RGB(255, 0, 0)])
remap_numbers = RemapNumbers(Value=list_item_2, Source=bounds, Target="1 to 10")  # -> Mapped, Clipped

# ---- group: export study boundary to shp to clip source data / Ready to Export?
boolean_toggle = BooleanToggle(False)  # disabled

# ---- group: Preview sidewalk centers with Width Value / Display
# Display
data_2 = Data(graft(reference_by_layer_3))
custom_preview_lineweights = CustomPreviewLineweights(Geometry=data_2, Shader=gradient, Thickness=remap_numbers.Mapped, Absolute=Toggle(False))

# ----
sort_list = SortList(Keys=point_to_lat_long.Longitude)  # -> Keys, ValuesValuesA; disabled
sort_list_2 = SortList(Keys=point_to_lat_long.Latitude)  # -> Keys, ValuesValuesA; disabled
list_item_3 = ListItem(List=sort_list.Keys, Index=0, Wrap=True)  # -> Item1, Item; disabled
list_item_4 = ListItem(List=sort_list_2.Keys, Index=0, Wrap=True)  # -> Item1, Item; disabled
panel_3 = Panel(list_item_4.Item)  # disabled
panel_4 = Panel(list_item_4.Item1)  # disabled
higher = Panel(list_item_3.Item)  # disabled
lower = Panel(list_item_3.Item1)  # disabled
number = Number(panel_3)  # disabled
number_2 = Number(lower)  # disabled
number_3 = Number(higher)  # disabled
number_4 = Number(panel_4)  # disabled

# ----
# note: use the above coordinates to download urban data:
# https://www.openstreetmap.org/export#map=16/40.8056/-73.9481
map_path = Panel("Urbano_OSM_Map.osm")  # disabled
relative_path_8 = RelativePath(Path=map_path)  # disabled

# ---- group: import geom
layer_name_4 = Panel("Source Data::Parcels::All")  # disabled
reference_by_layer_5 = ReferenceByLayer(LayerName=layer_name_4)  # -> graft(Geometry); disabled

# ----
# URL / File Path
# Use Note: create a rectangle around the model reagion to study.  You will need to download OSM data for this area
download_openstreetmap_osm = DownloadOpenStreetMapOSM(LeftBound=number_3, RightBound=number_2, TopBound=number_4, BottomBound=number, FilePath=relative_path_8, RunToggle=True)  # -> OSMQueryURL, OSMFilePath; disabled
url = Text(download_openstreetmap_osm.OSMQueryURL)  # disabled

# ---- group: Import Geometries
import_osm_features = ImportOSMFeatures(OSMPathOrURL=url, OSMFeatureType="street", Format="xml")  # -> Points, Metadata, UTMZone, TranslationVector; disabled
import_osm_features_2 = ImportOSMFeatures(OSMPathOrURL=url, OSMFeatureType="building", Format="xml")  # -> Points, Metadata, UTMZone, TranslationVector; disabled
# Build OSM DATA
# H
import_osm_features_3 = ImportOSMFeatures(OSMPathOrURL=url, OSMFeatureType="amenity", Format="xml")  # -> Points, Metadata, UTMZone, TranslationVector; disabled

# ----
lookup_metadata = LookupMetadata(MetadataGeometry=import_osm_features_3.Metadata, SearchKey="amenity")  # disabled
amenity_capacity = AmenityCapacity(
    Activity=lookup_metadata,
    Area=-1,
    LogisticsAreaProportion=0.2,
    AmenityCapacityData="""post_office, 5, 15
bank, 5, 15
cinema, 1, 248
theatre, 1, 215
arts_centre, 3, 20
department_store, 1, 78
supermarket_store, 2, 32
convenience_store, 1, 39
hardware_store, 1, 50
pharmacy, 1, 42
restaurant, 2, 35
fast_food, 1, 36
cafe, 1, 50
bar, 1, 47
pub, 1, 47
clothes_store, 2, 21
books_store, 1, 26
beauty_store, 1, 27
shoes_store, 1, 38""")  # disabled
polyline = PolyLine(Vertices=import_osm_features_2.Points, Closed=False)  # disabled
data_3 = Data(import_osm_features_2.Metadata)  # disabled
merge_metadata = MergeMetadata(Metadata=amenity_capacity, Metadata_2=import_osm_features_3.Metadata)  # disabled

create_amenity = CreateAmenity(PointLocationOfAmenity=import_osm_features_3.Points, Metadata=merge_metadata)  # disabled
arrange_amenities_by_building = ArrangeAmenitiesByBuilding(Amenities=flatten(create_amenity), Buildings=flatten(polyline))  # -> AmenitiesByBuilding, Buildings; disabled

polyline_2 = PolyLine(Vertices=import_osm_features.Points, Closed=False)  # disabled
create_street_network = CreateStreetNetwork(
    StreetCurves=flatten(polyline_2),
    Metadata=flatten(import_osm_features.Metadata),
    SplitStreetCurves=True,
    UTMZone=import_osm_features.UTMZone,
    TranslationVector=import_osm_features.TranslationVector)  # -> StreetNetwork, StreetSegmentCurves, UTMZone, TranslationVector; disabled

create_building = CreateBuilding(
    BuildingCurve=arrange_amenities_by_building.Buildings,
    Metadata=data_3,
    AmenitiesInBuilding=arrange_amenities_by_building.AmenitiesByBuilding)  # disabled

# ----
# Input ADP Data
# Click "Build Toggle" to Run !
model = BuildUrbanoModel(Buildings=flatten(create_building), StreetNetwork=create_street_network.StreetNetwork, BuildToggle=True)  # -> UrbanoModel, BuildingCurves, Activities; disabled
# Build Trip Model
# I
adper = ActivityDemandProfilePersona(
    ColumnIndex=1,
    Normalize=False,
    Persona="""post_office,0.000393276
bank,0.004129387
cinema,0.065873563
theatre,0.039524137
arts_centre,0.00934028
pharmacy,0.071084456
restaurant,0.22711631
fast_food,0.016812506
cafe,0.071969324
bar,0.116606037
pub,0.116606037
department_store,0.01641923
supermarket_store,0.055550094
convenience_store,0.010323469
hardware_store,0.005702488
clothes_store,0.102743094
books_store,0.008947007
shoes_store,0.028512436
beauty_store,0.032346868""")  # disabled
adp_trip_engine = ADPTripEngine(
    UrbanoModel=model.UrbanoModel,
    Building=model.BuildingCurves,
    ActivityDemandProfile=adper,
    SingleTravelMode="pedestrian",
    DestinationChoiceModel="nearest",
    BuildToggle=True)  # disabled
model_2 = UrbanoModel(model.UrbanoModel)  # disabled

# ----
# J
# Enable Preview to
# Show AmenityHits, Amentyscore and Capacity
amenhits = AmenityHits(Trips=flatten(adp_trip_engine))  # -> Amenity, AmenityHits, AmenityHosts, AmTrips; disabled
# Study or Use Results
inamen = InspectAmenity(Amenity=amenhits.Amenity)  # -> Name, Activities, Host, Metadata; disabled

# ---- group: Building Hits
# Enable Preview to
# Show BuildingHits Gradient
bldghits = BuildingHits(Trips=flatten(adp_trip_engine))  # -> BuildingCurves, BuildingHits, BuildingTrips; disabled
inbldg = InspectBuilding(Building=bldghits.BuildingCurves)  # -> Geometry, Metadata, Amenity, BuildingMesh; disabled

# ---- group: Street Hits
# Enable Preview to
# Show StreetHits Gradient
sthits = StreetHits(UrbanoModel=model_2, Trips=flatten(adp_trip_engine))  # -> StreetCurves, StreetHits, StTrips; disabled

# ----
reverse = Reverse(Vector=create_street_network.TranslationVector)  # disabled
move = Move(Geometry=model.BuildingCurves, Motion=reverse)  # -> Geometry, Transform; disabled
control_points_2 = ControlPoints(Curve=move.Geometry)  # -> simplify(Points), Weights, Knots; disabled

reverse_2 = Reverse(Vector=create_street_network.TranslationVector)  # disabled
move_2 = Move(Geometry=inbldg.Geometry, Motion=reverse_2)  # -> Geometry, Transform; disabled
control_points_3 = ControlPoints(Curve=move_2.Geometry)  # -> simplify(Points), Weights, Knots; disabled

data_4 = Data(sthits.StreetHits)  # disabled
bounds_2 = Bounds(Numbers=data_4)  # disabled
deconstruct_domain_2 = DeconstructDomain(Domain=bounds_2)  # -> Start, End; disabled
gradient_2 = Gradient(
    LowerLimit=deconstruct_domain_2.Start,
    UpperLimit=deconstruct_domain_2.End,
    Parameter=data_4,
    stops=[0: RGB(234, 38, 0), 0.25: RGB(234, 126, 0), 0.5: RGB(254, 244, 84), 0.75: RGB(173, 203, 249), 1: RGB(75, 107, 169)])  # disabled

reverse_3 = Reverse(Vector=create_street_network.TranslationVector)  # disabled
move_3 = Move(Geometry=sthits.StreetCurves, Motion=reverse_3)  # -> Geometry, Transform; disabled
control_points_4 = ControlPoints(Curve=move_3.Geometry)  # -> simplify(Points), Weights, Knots; disabled

# ---- group: Re-Project To Site
file_name_2 = Panel("Source Data\2149.prj")  # disabled
file_name_3 = Panel("Source Data\NYC_Sidewalk_Planametrics.prj")  # disabled
relative_path_9 = RelativePath(Path=file_name_2)  # disabled
point_to_lat_long_2 = PointToLatLong(ProjectedPoint=control_points_2.Points, ProjectionFile=relative_path_9)  # -> Latitude, Longitude; disabled
relative_path_10 = RelativePath(Path=file_name_3)  # disabled
lat_long_to_point = LatLongToPoint(Latitude=point_to_lat_long_2.Latitude, Longitude=point_to_lat_long_2.Longitude, ProjectionFile=relative_path_10)  # disabled

file_name_4 = Panel("Source Data\2149.prj")  # disabled
file_name_5 = Panel("Source Data\NYC_Sidewalk_Planametrics.prj")  # disabled
relative_path_11 = RelativePath(Path=file_name_4)  # disabled
point_to_lat_long_3 = PointToLatLong(ProjectedPoint=control_points_3.Points, ProjectionFile=relative_path_11)  # -> Latitude, Longitude; disabled
relative_path_12 = RelativePath(Path=file_name_5)  # disabled
lat_long_to_point_2 = LatLongToPoint(Latitude=point_to_lat_long_3.Latitude, Longitude=point_to_lat_long_3.Longitude, ProjectionFile=relative_path_12)  # disabled

file_name_6 = Panel("Source Data\2149.prj")  # disabled
file_name_7 = Panel("Source Data\NYC_Sidewalk_Planametrics.prj")  # disabled
relative_path_13 = RelativePath(Path=file_name_6)  # disabled
point_to_lat_long_4 = PointToLatLong(ProjectedPoint=control_points_4.Points, ProjectionFile=relative_path_13)  # -> Latitude, Longitude; disabled
relative_path_14 = RelativePath(Path=file_name_7)  # disabled
lat_long_to_point_3 = LatLongToPoint(Latitude=point_to_lat_long_4.Latitude, Longitude=point_to_lat_long_4.Longitude, ProjectionFile=relative_path_14)  # disabled

# ----
polyline_3 = PolyLine(Vertices=lat_long_to_point, Closed=False)  # disabled

polyline_4 = PolyLine(Vertices=lat_long_to_point_2, Closed=False)  # -> flatten(Polyline); disabled

polyline_5 = PolyLine(Vertices=lat_long_to_point_3, Closed=False)  # -> flatten(Polyline); disabled
custom_preview = CustomPreview(Geometry=polyline_5, Material=gradient_2)  # disabled

# ---- group: export study boundary to shp to clip source data
# Use Note: Because the Large Size of source datasets you need to clip down the data. This script helps you export a study area to shp based on the new york 3d model.
file_name_8 = Panel("Model_Clipping_Boundary\Model_Clipping_Boundary.shp")  # disabled
file_name_9 = Panel("Source Data\NYC_Sidewalk_Planametrics.prj")  # disabled
entwine = Entwine(Branch00=geometry_2, FlattenInputs=True)  # disabled
fields = Panel("""Name
Area;System.Double""")  # disabled
entwine_2 = Entwine(Branch00=merge, FlattenInputs=True)  # disabled
relative_path_15 = RelativePath(Path=file_name_8)  # disabled
relative_path_16 = RelativePath(Path=file_name_9)  # disabled
geometry_3 = Geometry(entwine)  # disabled

# ---- group: export study boundary to shp to clip source data / Fields
data_5 = Data(fields)  # disabled

# ---- group: export study boundary to shp to clip source data / File to Export
file_path_2 = FilePath(relative_path_15)  # disabled

# ---- group: export study boundary to shp to clip source data / Attributes
data_6 = Data(entwine_2)  # disabled

# ---- group: export study boundary to shp to clip source data / Projection File
file_path_3 = FilePath(relative_path_16)  # disabled

# ---- group: export study boundary to shp to clip source data (continued)
polygonshp = PolygonSHP(
    PolygonTree=geometry_3,
    Fields=data_5,
    Attributes=data_6,
    PrjFilePath=file_path_3,
    FilePath=file_path_2,
    WriteFile=boolean_toggle)  # disabled

# ---- group: import and bake all landuse data
# Pre-Clipped Source: https://www1.nyc.gov/site/planning/data-maps/open-data/dwn-pluto-mappluto.page
boolean_toggle_2 = BooleanToggle(True)  # disabled
layer_name_5 = Panel("Source Data::Parcels::All")  # disabled
readshp = ReadShp(FilePath=relative_path_2, ReadFile=boolean_toggle_2)  # -> Fields, Attributes, Features; disabled
define_object_attributes = DefineObjectAttributes(UserKeys=readshp.Fields, UserValues=readshp.Attributes, Layer=layer_name_5)  # disabled
boolean_toggle_3 = BooleanToggle(False)  # disabled

polyline_6 = PolyLine(Vertices=readshp.Features, Closed=True)  # disabled
path_mapper = PathMapper(polyline_6, source="{a;b}", target="{a}")  # disabled

bake_objects = BakeObjects(Geometry=path_mapper, Attributes=define_object_attributes, BakeName=layer_name_5, Bake=boolean_toggle_3)  # disabled

# ---- group: import and bake sidewalk centerlines
boolean_toggle_4 = BooleanToggle(True)  # disabled
readshp_2 = ReadShp(FilePath=relative_path_6, ReadFile=boolean_toggle_4)  # -> Fields, Attributes, Features; disabled
layer_name_6 = Panel("Source Data::Sidewalks::Centerline")  # disabled
define_object_attributes_2 = DefineObjectAttributes(UserKeys=readshp_2.Fields, UserValues=readshp_2.Attributes, Layer=layer_name_6)  # disabled
boolean_toggle_5 = BooleanToggle(False)  # disabled

polyline_7 = PolyLine(Vertices=readshp_2.Features, Closed=False)  # disabled
path_mapper_2 = PathMapper(polyline_7, source="{a;b}", target="{a}")  # disabled

bake_objects_2 = BakeObjects(Geometry=path_mapper_2, Attributes=define_object_attributes_2, BakeName=layer_name_6, Bake=boolean_toggle_5)  # disabled

# ---- group: import and bake sidewalk planametric data
boolean_toggle_6 = BooleanToggle(True)  # disabled
readshp_3 = ReadShp(FilePath=relative_path_4, ReadFile=boolean_toggle_6)  # -> Fields, Attributes, Features; disabled
layer_name_7 = Panel("Source Data::Sidewalks::Planametric")  # disabled
define_object_attributes_3 = DefineObjectAttributes(UserKeys=readshp_3.Fields, UserValues=readshp_3.Attributes, Layer=layer_name_7)  # disabled
boolean_toggle_7 = BooleanToggle(False)  # disabled

polyline_8 = PolyLine(Vertices=readshp_3.Features, Closed=False)  # disabled
path_mapper_3 = PathMapper(polyline_8, source="{a;b}", target="{a}")  # disabled

# ----
boundary_surfaces = BoundarySurfaces(Edges=path_mapper_3)  # disabled

# ---- group: import and bake sidewalk planametric data (continued)
bake_objects_3 = BakeObjects(Geometry=boundary_surfaces, Attributes=define_object_attributes_3, BakeName=layer_name_7, Bake=boolean_toggle_7)  # disabled

# ----
geometry_4 = Geometry(reference_by_layer_5)  # disabled
geometry_5 = Geometry(geometry_4)  # disabled
boolean_toggle_8 = BooleanToggle(False)  # disabled

# ----
# Need to look up and Re-Map Land Use Values to Actual Words!
geometry_6 = Geometry(geometry_4)  # disabled
panel_5 = Panel("LandUse")  # disabled
get_user_value = GetUserValue(Geometry=geometry_6, Key=panel_5)  # disabled
get_user_attributes_3 = GetUserAttributes(Geometry=geometry_6)  # -> Keys, Values, BakeName; disabled
layer_name_8 = Panel("Source Data::Parcels::LandUse::")  # disabled
concatenate = Concatenate(FragmentA=layer_name_8, FragmentB=get_user_value)  # disabled
define_object_attributes_4 = DefineObjectAttributes(UserKeys=get_user_attributes_3.Keys, UserValues=get_user_attributes_3.Values, Layer=concatenate)  # disabled

bake_objects_4 = BakeObjects(Geometry=geometry_5, Attributes=define_object_attributes_4, BakeName=layer_name_8, Bake=boolean_toggle_8)  # disabled

trip_amenityscore = TripAmenityscore(Trips=flatten(adp_trip_engine))  # -> Amenityscore, Amenity, AmenityHosts; disabled

reverse_4 = Reverse(Vector=create_street_network.TranslationVector)  # disabled
move_4 = Move(Geometry=trip_amenityscore.AmenityHosts, Motion=reverse_4)  # -> Geometry, Transform; disabled
control_points_5 = ControlPoints(Curve=move_4.Geometry)  # -> simplify(Points), Weights, Knots; disabled

bounds_3 = Bounds(Numbers=trip_amenityscore.Amenityscore)  # disabled
deconstruct_domain_3 = DeconstructDomain(Domain=bounds_3)  # -> Start, End; disabled
gradient_3 = Gradient(
    LowerLimit=deconstruct_domain_3.End,
    UpperLimit=deconstruct_domain_3.Start,
    Parameter=trip_amenityscore.Amenityscore,
    stops=[0: RGB(234, 38, 0), 0.25: RGB(234, 126, 0), 0.5: RGB(254, 244, 84), 0.75: RGB(173, 203, 249), 1: RGB(75, 107, 169)])  # disabled
custom_preview_2 = CustomPreview(Geometry=trip_amenityscore.AmenityHosts, Material=gradient_3)  # disabled

# ---- group: Re-Project To Site
file_name_10 = Panel("Source Data\2149.prj")  # disabled
file_name_11 = Panel("Source Data\NYC_Sidewalk_Planametrics.prj")  # disabled
relative_path_17 = RelativePath(Path=file_name_10)  # disabled
point_to_lat_long_5 = PointToLatLong(ProjectedPoint=control_points_5.Points, ProjectionFile=relative_path_17)  # -> Latitude, Longitude; disabled
relative_path_18 = RelativePath(Path=file_name_11)  # disabled
lat_long_to_point_4 = LatLongToPoint(Latitude=point_to_lat_long_5.Latitude, Longitude=point_to_lat_long_5.Longitude, ProjectionFile=relative_path_18)  # disabled

# ----
polyline_9 = PolyLine(Vertices=lat_long_to_point_4, Closed=False)  # -> flatten(Polyline); disabled

custom_preview_3 = CustomPreview(Geometry=polyline_9, Material=gradient_3)  # disabled
