# Grasshopper definition _2_SocialDistance_Sidewalk_Analysis.gh (Grasshopper 1.0.7)
# plug-ins: Human UI, EleFront, MetaHopper, SidewalkSocialDistancingPlugin, HDTTreeUtils, TT Toolbox

# ---- group: Import
# Import
panel = Panel("Import")
selobj = GetSelectedObjects()  # -> ComponentObjects, ParamObjects, OtherObjects
lblgrp = LabelGroups(Groups=selobj.OtherObjects, Run=Toggle(True))
setscribble = SetScribbleProperties(Scribble=lblgrp, ScribbleText=panel, ScribbleSize=Slider(15, range=0..100))
setgroup = SetGroupProperties(Group=selobj.OtherObjects, Style=1, NickName=panel, Color=ColourSwatch(SwatchColor=RGBA(217, 255, 25, 86)))

# ----
# Import Notes: Ex: Be sure that you use the CSV not the EXCEL
# Data Collection Source: EX:::>>>-- http://www.pasda.psu.edu/
# EX:::>>>-- http://pittsburghpa.gov/dcp/gis/gis-data-new
path = FilePath()
path_2 = FilePath()

# ---- group: TT ToolBOX
readxl = ReadExcelSheet(Worksheet="1", Listen=False)  # -> UserMessages, Columns, Rows

# ---- group: Ref
selobj_2 = GetSelectedObjects()  # -> ComponentObjects, ParamObjects, OtherObjects
# Select Groups and Pres left "select button" to apply style
number_slider = Slider(15, range=0..100)
lblgrp_2 = LabelGroups(Groups=selobj_2.OtherObjects, Run=Toggle(True))
setscribble_2 = SetScribbleProperties(Scribble=lblgrp_2, ScribbleText="Ref", ScribbleSize=number_slider)
setgroup_2 = SetGroupProperties(Group=selobj_2.OtherObjects, Style=1, NickName="Ref", Color=ColourSwatch(SwatchColor=RGBA(235, 141, 141, 133)))

# ---- group: ##NAME##:Important Controler
toggle = BooleanToggle(False)

number_slider_2 = Slider(0, range=0..10)

number_slider_3 = Slider(0, range=0..10)

# ---- group: Display
# Display
# Display
panel_2 = Panel("Display")
selobj_3 = GetSelectedObjects()  # -> ComponentObjects, ParamObjects, OtherObjects
lblgrp_3 = LabelGroups(Groups=selobj_3.OtherObjects, Run=Toggle(True))
setscribble_3 = SetScribbleProperties(Scribble=lblgrp_3, ScribbleText=panel_2, ScribbleSize=Slider(15, range=0..100))
setgroup_3 = SetGroupProperties(Group=selobj_3.OtherObjects, Style=1, NickName=panel_2, Color=ColourSwatch(SwatchColor=RGBA(0, 251, 255, 133)))

# ----
# Display / Visual blocks
swatch = ColourSwatch(SwatchColor=RGB(59, 209, 209))

# ---- group: ##Stuff being Previewed##
preview = CustomPreview(Shader=swatch)

# ---- group: Color Picker
colour = ColourPicker(PickedColour=RGB(255, 105, 180))

# ----
# Want this as your Template File?: File->
#     Preferences->
#         Files ->
#             Template File ->
selobj_4 = GetSelectedObjects()  # -> ComponentObjects, ParamObjects, OtherObjects
# Notes and Comments
number_slider_4 = Slider(15, range=0..100)
lblgrp_4 = LabelGroups(Groups=selobj_4.OtherObjects, Run=Toggle(True))
setscribble_4 = SetScribbleProperties(Scribble=lblgrp_4, ScribbleSize=number_slider_4)
# Panel Heading: Panels are good for giveing blocks of text a little more structure and flexability
# 
# they can be resized and moved around makeing them good for instructions
swatch_2 = ColourSwatch(SwatchColor=RGBA(255, 255, 255, 125))
setgroup_4 = SetGroupProperties(Group=selobj_4.OtherObjects, Style=1, Color=swatch_2)

selobj_5 = GetSelectedObjects()  # -> ComponentObjects, ParamObjects, OtherObjects
lblgrp_5 = LabelGroups(Groups=selobj_5.OtherObjects, Run=Toggle(True))
setscribble_5 = SetScribbleProperties(Scribble=lblgrp_5, ScribbleSize=Slider(15, range=0..100))
setgroup_5 = SetGroupProperties(Group=selobj_5.OtherObjects, Style=1, Color=ColourSwatch(SwatchColor=RGBA(114, 171, 108, 68)))

# ---- group: ##BUBBLE NAME## Notes Pupose or Opperation
# SCRIBBLE TITLE - Gives Heading to Section
data = Data()

# ----
document_info = DocumentInfo(AutoUpdate=False, Recursive=False)  # -> DocumentName, DocumentFilePath, Components, Params, _3rdPartyAssemblies
file_path = Panel(document_info.DocumentFilePath)
name = Panel(document_info.DocumentName)
plugins = Panel(document_info._3rdPartyAssemblies)

# ----
# <Spcial Distance Sidewalk Analysis>
# 
# Project # : KPF Code Test
# Script Author: Nicolas Azel
# Date Created: 4/25/21
# Script Discription
# Example One classifies sidewalks for
# social distancing risk based on width
# and Example two land use data to
# estimate use intensity.
# Plug-in Dependancy
# List Nessisary Plug-ins To Run the Script
# Plug-in Library: {0;0}
# 0. EleFront, Version=0.4.1.0, Culture=neutral, PublicKeyToken=null
# 1. Sidewalk_Social_Distancing_Plugin, Version=1.0.0.0, Culture=neutral, PublicKeyToken=null
# 2. HumanUI, Version=0.8.5.0, Culture=neutral, PublicKeyToken=null
# 3. HDTTreeUtils, Version=1.0.0.0, Culture=neutral, PublicKeyToken=null
# 4. CORE.Grasshopper.Public, Version=1.9.6353.28734, Culture=neutral, PublicKeyToken=null
# 5. MetaHopper, Version=1.0.5.0, Culture=neutral, PublicKeyToken=null
# Rhino File's
rhino_files_associated_with_script = Panel("SocialDistance_Example_Workspace.3dm")

# ----
# Data Set's Used
data_set_file_paths_or_source_directory = Panel("See 'Source Data' Folder")

simple_title = Panel("Set Title")
# Example 2
# This is example shows how to add weighting
#  with external data sources.
# 
# In this case using City Parcel Data and
# use type square footage multipliers to
# estimate risk at different times of the week.
colour_swatch = ColourSwatch(SwatchColor=RGB(35, 112, 235))
merge = Merge(
    Data1=ColourSwatch(SwatchColor=RGB(140, 32, 66)),
    Data2=ColourSwatch(SwatchColor=RGB(217, 50, 50)),
    Data3=ColourSwatch(SwatchColor=RGB(222, 86, 13)),
    Data4=ColourSwatch(SwatchColor=RGB(74, 217, 143)),
    Data5=colour_swatch)
create_label = CreateLabel(LabelText=simple_title, LabelSize=18, Justification=0)
create_color_picker = CreateColorPicker(DefaultColor=merge)
merge_2 = Merge(Data1=create_label, Data2=create_color_picker)

simple_title_2 = Panel("Set Range")
panel_3 = Panel("""0 to 4
4 to 6
6 to 10
10 to 20
20 to 100""")
create_text_box = CreateTextBox(DefaultText=panel_3, UpdateButton=True, showLabel=True)
create_label_2 = CreateLabel(LabelText=simple_title_2, LabelSize=18, Justification=0)
merge_3 = Merge(Data1=create_label_2, Data2=create_text_box)

# ----
# Example 1
# This is a basic example of the
# Social Distance Sidewalk Analyisis Plugin.
# It uses HumanUI to set Risk
# Class By Sidewalk Width, Provides
# a Mesh Preview in Rhino and a
# Graphical Breakdown of Proportional
# Risk Levels
# B
# HumanUI Weighting Class UI
simple_title_3 = Panel("Set Name")
create_label_3 = CreateLabel(LabelText=simple_title_3, LabelSize=18, Justification=0)

panel_4 = Panel("""Very Risky
Risky
Use Caution
Low Risk
Little to No Risk""")
create_text_box_2 = CreateTextBox(DefaultText=panel_4, UpdateButton=True, showLabel=True)
merge_4 = Merge(Data1=create_label_3, Data2=create_text_box_2)

# ---- group: import parcel data. this gometry has gis attributes bakes in with elfront
# Use Intensity Weighting
# B
# Data Ref: See Data Dictionary Here:
# https://www1.nyc.gov/assets/planning/download/pdf/data-maps/open-data/pluto_datadictionary.pdf?v=21v1
# Use Note: Note Any Objects and Weighting can Be provided, Either form additional datasources like Urbano Time Based activites or user constructed layers.
parcel_layer_name = Panel("Source Data::Parcels::All")
reference_by_layer = ReferenceByLayer(LayerName=parcel_layer_name)

# ----
panel_5 = Panel("""Use the Interface Below to Design and Calibraigh your Weighting Class. 
Click the button nex to the text field to submit changes. """)
create_text_block = CreateTextBlock(Text=panel_5, TextSize=12, Justification=0)

launch_window = LaunchWindow(
    Show=Toggle(True),
    Name="Define Risk Classification Details",
    Width="450",
    Height="300",
    ChildStatus=0,
    EnableHorizScroll=False)

entwine = Entwine(Branch00=merge_4, Branch01=merge_3, Branch02=merge_2, FlattenInputs=True)
create_simple_grid = CreateSimpleGrid(UIElements=entwine, RowDefinitions="Auto", ColumnDefinitions="Auto")

# ---- group: Import
# Calculate Polygon Center and Widths
# A
# Import Sidewalk
# Brep Surfaces from
# Rhino to Analyze
surface = Surface(graft([<surface referenced from the Rhino model> x12]))

# ---- group: sample distance
panel_6 = Panel("5")

# ---- group: Get Use Areas for Use in Wieghting
use_area_fields = Panel("""ComArea
ResArea
OfficeArea
RetailArea
GarageArea
StrgeArea
FactoryArea
OtherArea""")
geometry = Geometry(reference_by_layer)
get_user_value = GetUserValue(Geometry=geometry, Key=use_area_fields)

# ---- group: Import
# Calculate Polygon Center and Widths
# A
# Import Sidewalk
# Brep Surfaces from
# Rhino to Analyze
surface_2 = Surface(graft([<surface referenced from the Rhino model> x12]))

# ---- group: Examples of Time Based Weighting -- Jump between panels to see changes
# note: these are fictional multipliers and would require further reaserch to attribute accurate numbers
generic = Panel("""6
5
6
8
2
0
4
5""")
weekend = Panel("""6
6
2
8
2
0
0
5""")
weekday = Panel("""6
2
7
4
2
0
6
5""")

# ---- group: Custom C# Plugin Components
polygoncenterline = PolygonCenterline(Surface=surface, DivideDist=panel_6)  # -> CenterLine, Edges
sidewalkwidths = SidewalkWidths(Centerline=polygoncenterline.CenterLine, Edges=polygoncenterline.Edges)  # -> SizeLines, Widths, SamplePoints, SampleLines

# ---- group: Construct Risk Weighting
use_type_risk_multipler = Panel("""5
5
6
8
2
0
4
5""")
multiplication = Multiplication(A=get_user_value, B=weekday)
mass_addition = MassAddition(Input=multiplication)  # -> Result, PartialResults
bounds = Bounds(Numbers=flatten(mass_addition.Result))
remap_numbers = RemapNumbers(Value=mass_addition.Result, Source=bounds, Target=Domain(0, 1))  # -> flatten(Mapped), Clipped

# ---- group: Sample Distance
panel_7 = Panel("5")

# ----
add_elements = AddElements(Window=launch_window, Elements=flatten([create_simple_grid, create_text_block]), DoVLChecking=True)  # -> AddedElements, ElementNames
set_window_properties = SetWindowProperties(Window=launch_window, Theme=0, ShowTitleBar=True, BackgroundColor=RGB(255, 255, 255), ScaleFactor=1)

# ---- group: Custom C# Plugin Components
polygoncenterline_2 = PolygonCenterline(Surface=surface_2, DivideDist=panel_7)  # -> CenterLine, Edges
sidewalkwidths_2 = SidewalkWidths(Centerline=polygoncenterline_2.CenterLine, Edges=polygoncenterline_2.Edges)  # -> SizeLines, Widths, SamplePoints, SampleLines

# ---- group: sidewalk width lines
curve = Curve(sidewalkwidths.SampleLines)

# ---- group: center to edge lines
geometry_2 = Geometry(sidewalkwidths.SizeLines)

# ---- group: sidewalks
surface_3 = Surface(surface)

# ---- group: center to edge distance
data_2 = Data(sidewalkwidths.Widths)

# ---- group: sample locations along center
point = Point(sidewalkwidths.SamplePoints)

# ----
length = Length(Curve=curve)

# ---- group: Polygon Center used for speed over more precise options.
geometry_3 = Geometry(geometry)
polygon_center = PolygonCenter(Polyline=geometry_3)  # -> CenterV, CenterE, CenterA

# ---- group: center to edge lines
geometry_4 = Geometry(sidewalkwidths_2.SizeLines)

# ---- group: sidewalks
surface_4 = Surface(surface_2)

# ---- group: width sample locations
point_2 = Point(sidewalkwidths_2.SamplePoints)

# ---- group: Sidewalk width lines
curve_2 = Curve(sidewalkwidths_2.SampleLines)

# ---- group: center to edge length
data_3 = Data(sidewalkwidths_2.Widths)

# ---- group: number of weight points to consider per vertex
panel_8 = Panel("3")

# ---- group: Custom C# Plugin Component
# C
# Visualize Sidewalk Risk
visualizeanalysis = VisualizeAnalysis(Mesh=surface_3, WeightPoints=point, Weights=length, WightCount=panel_8)  # -> Mesh, Weights

# ---- group: Map width to risk level domain / Width
data_4 = Data(visualizeanalysis.Weights)

# ----
# Visualize Sidewalk Width
length_2 = Length(Curve=flatten(curve_2))
# Calculate and Visualize Intensity
# C
point_3 = Point(flatten(point_2))

# ---- group: number of weight points to consider per vertex
panel_9 = Panel("3")

# ---- group: Weighting Points
data_5 = Data(polygon_center.CenterE)

# ---- group: Weight
data_6 = Data(remap_numbers.Mapped)

# ----
# D
# Design New Weighting Algorithms
point_4 = Point(point_2)

# ---- group: number of weight points to consider per vertex
panel_10 = Panel("1")

# ---- group: Custom C# Plugin Component
visualizeanalysis_2 = VisualizeAnalysis(Mesh=surface_4, WeightPoints=polygon_center.CenterE, Weights=remap_numbers.Mapped, WightCount=panel_9)  # -> Mesh, Weights

visualizeanalysis_3 = VisualizeAnalysis(Mesh=surface_4, WeightPoints=point_3, Weights=length_2, WightCount=panel_10)  # -> Mesh, Weights

# ---- group: map to color
data_7 = Data(visualizeanalysis_2.Weights)
bounds_2 = Bounds(Numbers=flatten(data_7))
# Visualize Land Use Activity Weighting
deconstruct_domain = DeconstructDomain(Domain=bounds_2)  # -> Start, End
panel_11 = Panel(deconstruct_domain.End)
panel_12 = Panel(deconstruct_domain.Start)
gradient = Gradient(
    LowerLimit=panel_11,
    UpperLimit=panel_12,
    Parameter=data_7,
    stops=[0: RGB(234, 38, 0), 0.25: RGB(234, 126, 0), 0.5: RGB(254, 244, 84), 0.75: RGB(173, 203, 249), 1: RGB(75, 107, 169)])

# ---- group: Ref
number_slider_5 = Slider(3, range=0..10)

# ---- group: single closest / Sidewalk Points
point_5 = Point(point_4)

# ---- group: average of nearby
point_6 = Point(point_4)
data_8 = Data(data_5)
data_9 = Data(data_6)
closest_points = ClosestPoints(Point=point_6, Cloud=data_8, Count=number_slider_5)  # -> ClosestPoint, CPIndex, Distance
list_item = ListItem(List=data_9, Index=closest_points.CPIndex, Wrap=True)
average = Average(Input=list_item)  # -> simplify(ArithmeticMean)
path_mapper = PathMapper(average, source="{a;b}", target="{a}")
data_10 = Data(path_mapper)

# ---- group: single closest / Weight
data_11 = Data(data_6)

# ---- group: single closest / Weighting Points
data_12 = Data(data_5)

# ---- group: map to color
data_13 = Data(visualizeanalysis_3.Weights)
bounds_3 = Bounds(Numbers=flatten(data_13))
deconstruct_domain_2 = DeconstructDomain(Domain=bounds_3)  # -> Start, End
panel_13 = Panel(deconstruct_domain_2.End)
panel_14 = Panel(deconstruct_domain_2.Start)
gradient_2 = Gradient(
    LowerLimit=panel_14,
    UpperLimit=panel_13,
    Parameter=data_13,
    stops=[0: RGB(234, 38, 0), 0.25: RGB(234, 126, 0), 0.5: RGB(254, 244, 84), 0.75: RGB(173, 203, 249), 1: RGB(75, 107, 169)])

# ---- group: single closest
closest_point = ClosestPoint(Point=point_5, Cloud=data_12)  # -> ClosestPoint, CPIndex, Distance
list_item_2 = ListItem(List=data_11, Index=closest_point.CPIndex, Wrap=True)
data_14 = Data(list_item_2)

# ----
# D
boolean_toggle = BooleanToggle(True)
# HumanUI Graph Results
launch_window_2 = LaunchWindow(Show=boolean_toggle, Name="Risk Breakdown", Width="600", Height="300", ChildStatus=0, EnableHorizScroll=False)

# ----
# right click chart type to change
panel_15 = Panel("""1
2
3
4
5""")
panel_16 = Panel("""Very Risky
Risky
Use Caution
Low Risk
Little to No Risk""")
field_name = Panel("Proportional Risk Distribution by  Sidewalk Length")
create_chart = CreateChart(Data=panel_15, Names=panel_16, Title=field_name, ChartType=1)

# ---- group: Display
mesh = Mesh(visualizeanalysis_2.Mesh)
mesh_colours = MeshColours(Mesh=mesh, Colours=gradient)

mesh_2 = Mesh(visualizeanalysis_3.Mesh)
mesh_colours_2 = MeshColours(Mesh=mesh_2, Colours=gradient_2)

data_15 = Data(data_14)
sort_list = SortList(Keys=flatten(data_15))  # -> Keys, ValuesValuesA
quick_graph = QuickGraph(sort_list.Keys, SortOrder=0)
data_16 = Data(data_15)

# ----
value_listener = ValueListener(Elements=create_simple_grid, SomeProperty=True)  # -> Values, Indices

# ---- group: Slider OUtputs form window to control your script
explode_tree = ExplodeTree(Data=value_listener.Values)  # -> Branch0, Branch1, Branch2, Branch3, Branch4, Branch5, Branch6, Branch7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

# ----
merge_5 = Merge(
    Data1=explode_tree.Branch7,
    Data2=explode_tree.Branch8,
    Data3=explode_tree.Branch9,
    Data4=explode_tree.Branch10,
    Data5=explode_tree.Branch11)  # -> flatten(Result)
merge_6 = Merge(
    Data1=explode_tree.Branch13,
    Data2=explode_tree.Branch14,
    Data3=explode_tree.Branch15,
    Data4=explode_tree.Branch16,
    Data5=explode_tree.Branch17)  # -> flatten(Result)
merge_7 = Merge(
    Data1=explode_tree.Branch1,
    Data2=explode_tree.Branch2,
    Data3=explode_tree.Branch3,
    Data4=explode_tree.Branch4,
    Data5=explode_tree.Branch5)  # -> flatten(Result)
class = Panel(merge_7)
range = Panel(merge_5)
color = Panel(merge_6)

# ---- group: Map width to risk level domain / Risk Domain
data_17 = Data(range)

# ---- group: Map width to risk level domain / Risk Color
data_18 = Data(color)

# ---- group: Map width to risk level domain
find_domain = FindDomain(Domains=data_17, Number=data_4, Strict=False)  # -> Index, Neighbour
list_item_3 = ListItem(List=data_18, Index=find_domain.Index, Wrap=True)

# ---- group: Display
mesh_3 = Mesh(visualizeanalysis.Mesh)
mesh_colours_3 = MeshColours(Mesh=mesh_3, Colours=list_item_3)

# ----
data_19 = Data(find_domain.Index)
assignpaths = AssignPaths(InputData=flatten(data_19), PathsToAssign=flatten(data_19))

list_item_4 = ListItem(List=assignpaths, Index=0, Wrap=True)
list_length = ListLength(List=assignpaths)  # -> flatten(Length)
list_item_5 = ListItem(List=class, Index=list_item_4, Wrap=True)  # -> flatten(Item)

add_elements_2 = AddElements(Window=launch_window_2, Elements=flatten(create_chart), DoVLChecking=True)  # -> AddedElements, ElementNames
set_chart_contents = SetChartContents(ChartToModify=create_chart, NewChartValues=list_length, NewChartNames=list_item_5)
set_window_properties_2 = SetWindowProperties(Window=launch_window_2, Theme=1, ShowTitleBar=True, BackgroundColor=RGB(255, 255, 255), ScaleFactor=1)
